# Grasshopper definition GEMtoHoneybee.ghx (Grasshopper 1.0.8)
# plug-ins: RhinoCodePluginGH, BH.UI.Grasshopper

# ----
# 1
panel = Panel("< Write GEM File Path here >")

# ----
# 2
# Trigger to Read File
x = Object(Component="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")

ironpython_2_script = IronPython2Script(path=panel)  # -> file, dir; inputs path: String
# ---------- ironpython_2_script: IronPython ----------
import os

path = os.path.normpath(path)
_file = os.path.basename(path)
_dir = os.path.dirname(path)

if not _file.endswith(".gem"):
    raise ValueError("File must be a .gem file")
# ---------- end ironpython_2_script ----------
filesettings = FileSettings(FileName=ironpython_2_script.file, Directory=ironpython_2_script.dir, Component="BH.oM.Adapter.FileSettings")
gemtohbjsoncommand = GEMToHBJSONCommand(GEMFile=filesettings, OutputDirectory=ironpython_2_script.dir, Component="BH.oM.LadybugTools.GEMToHBJSONCommand")
ladybugtoolsadapter = LadybugToolsAdapter(Component="{ ..ctor")
execute = Execute(Adapter=ladybugtoolsadapter, Command=gemtohbjsoncommand, Active=x, Component="{ .Execute")  # -> Output, Success

success = Panel(execute.Success)

panel_2 = Panel(execute.Output)
loadobjects = HBLoadObjects(hb_file=panel_2, load=x)  # -> out, hb_objs; plug-in component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
vizbytype = HBVisualizeByType(hb_objs=loadobjects.hb_objs)  # -> walls, interior_walls, roofs, ceilings, exterior_floors, interior_floors, air_walls, apertures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; plug-in component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
