# Grasshopper definition HoneybeeToGEM.ghx (Grasshopper 1.0.8)
# plug-ins: BH.UI.Grasshopper

# ----
# 2
panel = Panel("< Write Model Name Here >")

# ----
# 1
panel_2 = Panel("< Write HoneyBee Objects Here >")

# ----
# 3
# Trigger to Write File
x = Object(Component="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")

panel_3 = Panel("%USERPROFILE%\Downloads")
concatenate = Concatenate(FragmentA=panel, FragmentB=".hbjson")

bhom_sample_scripts = BHoMSampleScripts()
dumpobjects = HBDumpObjects(hb_objs=flatten(panel_2), name=panel, folder=panel_3, dump=x)  # -> out, hb_file; plug-in component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

filesettings = FileSettings(FileName=concatenate, Directory=panel_3, Component="BH.oM.Adapter.FileSettings")
hbjsontogemcommand = HBJSONToGEMCommand(HBJSONFile=filesettings, OutputDirectory=panel_3, Component="BH.oM.LadybugTools.HBJSONToGEMCommand")
ladybugtoolsadapter = LadybugToolsAdapter(Component="{ ..ctor")
execute = Execute(Adapter=ladybugtoolsadapter, Command=hbjsontogemcommand, Active=x, Component="{ .Execute")  # -> Output, Success

panel_4 = Panel(dumpobjects.hb_file)
panel_5 = Panel(execute.Success)
