# Grasshopper definition ConstructProgramTypeGH.gh (Grasshopper 1.0.7)
# plug-ins: BH.UI.Grasshopper

getinfo = GetInfo(Component="{ .GetInfo")
# <Script name>
# Loads/Schedules Set Up
# (Thermal Template)
project_number = Panel("")
setprojectid = SetProjectID(ProjectID=project_number, Component="{ .SetProjectID")
bhom_version_used_to_create = Panel("6.1")
bhom_version_currently_installed = Panel(getinfo)
genes = GenePool(
    Decimals=0,
    Maximum=21,
    Minimum=12,
    Value=[12, 12, 12, 12, 12, 12, 12, 21, 21, 21, 21, 21, 21, 21, 21, 21, 21, 21, 21, 12, 12, 12, 12, 12])
genes_2 = GenePool(
    Decimals=0,
    Maximum=30,
    Minimum=24,
    Value=[30, 30, 30, 30, 30, 30, 30, 24, 24, 24, 24, 24, 24, 24, 24, 24, 24, 24, 24, 30, 30, 30, 30, 30])

# ---- group: Setpoints - consider using schedule for setbacks
constantschedule = HBConstantSchedule(values=genes_2, name="Custom Defined Cooling", type_limit="Temperature")  # -> report, schedule, idf_text; plug-in component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
# Heating and Cooling
constantschedule_2 = HBConstantSchedule(values=genes, name="Custom Defined Heating", type_limit="Temperature")  # -> report, schedule, idf_text; plug-in component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
setpoint = HBSetpoint(name="Office Heating Cooling", heating_sch=constantschedule_2.schedule, cooling_sch=constantschedule.schedule)  # -> setpoint; plug-in component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

# ----
# Needs reviewing
number_slider = Slider(1, range=0..1)
number_slider_2 = Slider(0.0001, range=0..0.0001)
constantschedule_3 = HBConstantSchedule(values=number_slider, name="Infiltration", type_limit="On-Off")  # -> report, schedule, idf_text; plug-in component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
# use area to convert to ach and check against CIBSE.
# 3@50  = 0.3ach at perimeter (roughly)
# Table 4.XX etc
infiltration = HBInfiltration(name="User Defined Infiltration", flow_per_ext_area=Slider(0.0003, range=0..0.001), schedule=constantschedule_3.schedule)  # -> infil; plug-in component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

deconstrsch = HBDeconstructSchedule(schedule=constantschedule_3.schedule)  # -> day_names, day_data, type_limit; plug-in component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
data = Data(["0.25", "0.25", "0.25", "0.25", "0.25", "0.25"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])
data_2 = Data(["0", "0", "0", "0", "0", "0"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])

# ---- group: NABERS inputs
# Dave K - NABERS avg
# Dave K recommended
# Check latent sensible split on people
panel = Panel("C:\Users\cbrooker\BuroHappold\Design & Technology - Script Library\00425_CB Unsorted Scripts for sharing\BoxModel\NABERS Standard Equipment.csv")
panel_2 = Panel("C:\Users\cbrooker\BuroHappold\P050798 P-Bavaria House - Sustainability\Calculations\BuildingPhysics\220511 Box Model\NABERS Standard Lighting.csv")
panel_3 = Panel("C:\Users\cbrooker\BuroHappold\P050798 P-Bavaria House - Sustainability\Calculations\BuildingPhysics\220511 Box Model\NABERS Standard Occupancy.csv")
panel_4 = Panel("C:\Users\cbrooker\OneDrive - BuroHappold\Projects\Scripts\Grasshopper Scripts\BoxModel\NABERS-office-HVAC-availability.csv")
file = ReadFile(File=panel_2, PerLineParse=True)
file_2 = ReadFile(File=panel, PerLineParse=True)
file_3 = ReadFile(File=panel_4, PerLineParse=True)
file_4 = ReadFile(File=panel_3, PerLineParse=True)
panel_5 = Panel("NABERS office equipment profile")
nabers_office_lighting_auto_control_prof = Data(["0.05", "0.05", "0.05", "0.05", "0.05", "0.05"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])  # "NABERS office lighting auto control profile"
nabers_office_equipment_profile = Data(["0.25", "0.25", "0.25", "0.25", "0.25", "0.25"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])
nabers_office_occupancy_profile = Data(["0", "0", "0", "0", "0", "0"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])
panel_6 = Panel("NABERS office lighting auto control profile")
panel_7 = Panel("NABERS office occupancy profile")
panel_8 = Panel("NABERS office HVAC availability")
nabers_office_hvac_availability = Data(["0.00", "0.00", "0.00", "0.00", "0.00", "0.00"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])
fixedintervalschedule = HBFixedIntervalSchedule(values=data, name=panel_5)  # -> report, schedule; plug-in component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
fixedintervalschedule_2 = HBFixedIntervalSchedule(values=nabers_office_lighting_auto_control_prof, name=panel_6)  # -> report, schedule; plug-in component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
fixedintervalschedule_3 = HBFixedIntervalSchedule(values=data_2, name=panel_7)  # -> report, schedule; plug-in component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
fixedintervalschedule_4 = HBFixedIntervalSchedule(values=nabers_office_hvac_availability, name=panel_8)  # -> report, schedule; plug-in component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
m2_per_person = Slider(10, range=0..20)
# Gain levels may need to vary by project
number_slider_3 = Slider(11, range=0..100)
constantschedule_4 = HBConstantSchedule(values=Slider(120, range=0..1000), type_limit="Activity Level")  # -> report, schedule, idf_text; plug-in component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
one_over_x = OneOverX(Value=m2_per_person)
lighting = HBLighting(
    name="NABERS office lighting auto control",
    watts_per_area=Slider(4, range=0..10),
    schedule=fixedintervalschedule_2.schedule)  # -> lighting; plug-in component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
equipment = HBEquipment(name="NABERS office equipment", watts_per_area=number_slider_3, schedule=fixedintervalschedule.schedule)  # -> equip; plug-in component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
people = HBPeople(
    name="NABERS office occupancy",
    ppl_per_area=one_over_x,
    occupancy_sch=fixedintervalschedule_3.schedule,
    activity_sch=constantschedule_4.schedule)  # -> people; plug-in component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

# ---- group: NABERS profiles visualisation
concat = Concatenate(FragmentA="data:", FragmentB=panel_8)
concat_2 = Concatenate(FragmentA="data:", FragmentB=panel_7)
concat_3 = Concatenate(FragmentA="data:", FragmentB=panel_5)
concat_4 = Concatenate(FragmentA="data:", FragmentB=panel_6)
constrheader = LBConstructHeader(data_type="Fraction", unit="fraction", metadata=concat)  # -> header; plug-in component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
constrheader_2 = LBConstructHeader(data_type="Fraction", unit="fraction", metadata=concat_2)  # -> header; plug-in component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
constrheader_3 = LBConstructHeader(data_type="Fraction", unit="fraction", metadata=concat_3)  # -> header; plug-in component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
constrheader_4 = LBConstructHeader(data_type="Fraction", unit="fraction", metadata=concat_4)  # -> header; plug-in component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
data_3 = LBConstructData(header=constrheader, values=nabers_office_hvac_availability)  # -> data; plug-in component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
data_4 = LBConstructData(header=constrheader_2, values=data_2)  # -> data; plug-in component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
data_5 = LBConstructData(header=constrheader_3, values=data)  # -> data; plug-in component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
data_6 = LBConstructData(header=constrheader_4, values=nabers_office_lighting_auto_control_prof)  # -> data; plug-in component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
legendpar = LBLegendParameters(min=Slider(0, range=0..100), max=Slider(1, range=0..1))  # -> leg_par; plug-in component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
hourlyplot = LBHourlyPlot(data=[data_5, data_6, data_4, data_3], legend_par=legendpar)  # -> report, mesh, legend, borders, labels, title; plug-in component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

# ----
programtype = HBProgramType(
    name="NABERS Office",
    people=people,
    lighting=lighting,
    electric_equip=equipment,
    infiltration=infiltration,
    setpoint=setpoint)  # -> program; plug-in component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
dumpobjects = HBDumpObjects(
    hb_objs=flatten(programtype),
    name="NABERS Program - to be reviewed",
    folder="C:\Users\cbrooker\Desktop\Box_Model",
    dump=Toggle(True))  # -> report, hb_file; plug-in component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

# ----
# Program check
deconstrprogram = HBDeconstructProgramType(program=programtype)  # -> people, lighting, electric_equip, gas_equip, hot_water, infiltration, ventilation, setpoint; plug-in component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
decnstrsetpoint = HBDeconstructSetpoint(setpoint=deconstrprogram.setpoint)  # -> name, heating_sch, cooling_sch, humid_setpt, dehumid_setpt; plug-in component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
decnstrpeople = HBDeconstructPeople(people=deconstrprogram.people)  # -> name, ppl_per_area, occupancy_sch, activity_sch; plug-in component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
decnstrventilation = HBDeconstructVentilation(vent=deconstrprogram.ventilation)  # -> name, flow_per_person, flow_per_area, flow_per_zone, ach, schedule; plug-in component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
deconstrsch_2 = HBDeconstructSchedule(schedule=decnstrpeople.occupancy_sch)  # -> day_names, day_data, type_limit; plug-in component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
deconstrsch_3 = HBDeconstructSchedule(schedule=decnstrsetpoint.cooling_sch)  # -> day_names, day_data, type_limit; plug-in component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
xdata = LBDeconstructData(data=deconstrsch_3.day_data)  # -> header, values; plug-in component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
panel_9 = Panel(xdata.values)
