# Grasshopper definition ConstructProgramTypeGH_PartLNotionals.gh (Grasshopper 1.0.7)
# plug-ins: BH.UI.Grasshopper, LadybugGrasshopper

getinfo = GetInfo(Component="{ .GetInfo")
# <Script name>
project_number = Panel("")
setprojectid = SetProjectID(ProjectID=project_number, Component="{ .SetProjectID")
bhom_version_used_to_create = Panel("6.0")
bhom_version_currently_installed = Panel(getinfo)

opaquemat = HBOpaqueMaterial(
    name="IES Plasterboard",
    thickness=Slider(0.0125, range=0..0.1),
    conductivity=Slider(0.21, range=0..1),
    density=Slider(700, range=0..10000),
    spec_heat=Slider(1000, range=0..10000),
    therm_absp=Slider(0.9, range=0..1),
    sol_absp=Slider(0.55, range=0..1))  # -> mat; plug-in component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
opaquemat_2 = HBOpaqueMaterial(
    name="Cavity (wall air)",
    thickness=Slider(0.05, range=0..0.1),
    conductivity=Slider(0.667, range=0..1),
    density=Slider(1.28, range=0..10),
    spec_heat=Slider(1000, range=0..10000),
    therm_absp=Slider(0.9, range=0..1),
    sol_absp=Slider(0.7, range=0..1))  # -> mat; plug-in component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
merge = Merge(Data1=opaquemat, Data2=opaquemat_2, Data3=opaquemat)
opaqueconstr = HBOpaqueConstruction(name="IES Internal Partition", materials=merge)  # -> constr; plug-in component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

opaquemat_3 = HBOpaqueMaterial(
    name="Cavity (ceiling air)",
    thickness=Slider(0.05, range=0..0.1),
    conductivity=Slider(0.556, range=0..1),
    density=Slider(1.28, range=0..10),
    spec_heat=Slider(1000, range=0..10000),
    therm_absp=Slider(0.9, range=0..1),
    sol_absp=Slider(0.7, range=0..1))  # -> mat; plug-in component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
opaquemat_4 = HBOpaqueMaterial(
    name="IES Chipboard Flooring",
    thickness=Slider(0.0982, range=0..0.1),
    conductivity=Slider(0.025, range=0..0.1),
    density=Slider(700, range=0..1000),
    spec_heat=Slider(1000, range=0..10000),
    therm_absp=Slider(0.9, range=0..1),
    sol_absp=Slider(0.55, range=0..1))  # -> mat; plug-in component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
opaquemat_5 = HBOpaqueMaterial(
    name="IES Insulation Exposed Floor",
    thickness=Slider(0.0982, range=0..0.1),
    conductivity=Slider(0.025, range=0..0.1),
    density=Slider(700, range=0..1000),
    spec_heat=Slider(1000, range=0..10000),
    therm_absp=Slider(0.9, range=0..1),
    sol_absp=Slider(0.7, range=0..1))  # -> mat; plug-in component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
opaquemat_6 = HBOpaqueMaterial(
    name="IES Reinforced Concrete",
    thickness=Slider(0.1, range=0..0.1),
    conductivity=Slider(2.3, range=0..10),
    density=Slider(2300, range=0..10000),
    spec_heat=Slider(1000, range=0..10000),
    therm_absp=Slider(0.9, range=0..1),
    sol_absp=Slider(0.7, range=0..1))  # -> mat; plug-in component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
merge_2 = Merge(Data1=opaquemat_5, Data2=opaquemat_6, Data3=opaquemat_3, Data4=opaquemat_4)
opaqueconstr_2 = HBOpaqueConstruction(name="IES 2013 Exposed Floor", materials=merge_2)  # -> constr; plug-in component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

opaquemat_7 = HBOpaqueMaterial(
    name="IES Screed",
    thickness=Slider(0.05, range=0..0.1),
    conductivity=Slider(1.15, range=0..10),
    density=Slider(1800, range=0..10000),
    spec_heat=Slider(1000, range=0..10000),
    therm_absp=Slider(0.9, range=0..1),
    sol_absp=Slider(0.7, range=0..1))  # -> mat; plug-in component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
opaquemat_8 = HBOpaqueMaterial(
    name="Cavity (ceiling air)",
    thickness=Slider(0.05, range=0..0.1),
    conductivity=Slider(0.556, range=0..1),
    density=Slider(1.28, range=0..10),
    spec_heat=Slider(1000, range=0..10000),
    therm_absp=Slider(0.9, range=0..1),
    sol_absp=Slider(0.7, range=0..1))  # -> mat; plug-in component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
opaquemat_9 = HBOpaqueMaterial(
    name="IES Chipboard Flooring",
    thickness=Slider(0.0982, range=0..0.1),
    conductivity=Slider(0.025, range=0..0.1),
    density=Slider(700, range=0..1000),
    spec_heat=Slider(1000, range=0..10000),
    therm_absp=Slider(0.9, range=0..1),
    sol_absp=Slider(0.55, range=0..1))  # -> mat; plug-in component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
opaquemat_10 = HBOpaqueMaterial(
    name="IES Plasterboard",
    thickness=Slider(0.0125, range=0..0.1),
    conductivity=Slider(0.21, range=0..1),
    density=Slider(700, range=0..10000),
    spec_heat=Slider(1000, range=0..10000),
    therm_absp=Slider(0.9, range=0..1),
    sol_absp=Slider(0.55, range=0..1))  # -> mat; plug-in component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
opaquemat_11 = HBOpaqueMaterial(
    name="IES Reinforced Concrete",
    thickness=Slider(0.1, range=0..0.1),
    conductivity=Slider(2.3, range=0..10),
    density=Slider(2300, range=0..10000),
    spec_heat=Slider(1000, range=0..10000),
    therm_absp=Slider(0.9, range=0..1),
    sol_absp=Slider(0.7, range=0..1))  # -> mat; plug-in component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
merge_3 = Merge(Data1=opaquemat_9, Data2=opaquemat_8, Data3=opaquemat_7, Data4=opaquemat_11, Data5=opaquemat_8, Data6=opaquemat_10)
data = Data(reverse(merge_3))
opaqueconstr_3 = HBOpaqueConstruction(name="IES 2013 Floor", materials=data)  # -> constr; plug-in component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
opaqueconstr_4 = HBOpaqueConstruction(name="IES 2013 Ceiling", materials=merge_3)  # -> constr; plug-in component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

opaquemat_12 = HBOpaqueMaterial(
    name="IES Plasterboard",
    thickness=Slider(0.0125, range=0..0.1),
    conductivity=Slider(0.21, range=0..1),
    density=Slider(700, range=0..10000),
    spec_heat=Slider(1000, range=0..10000),
    therm_absp=Slider(0.9, range=0..1),
    sol_absp=Slider(0.55, range=0..1))  # -> mat; plug-in component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
opaquemat_13 = HBOpaqueMaterial(
    name="IES Concrete Deck",
    thickness=Slider(0.1, range=0..0.1),
    conductivity=Slider(2, range=0..10),
    density=Slider(2400, range=0..10000),
    spec_heat=Slider(1000, range=0..10000),
    therm_absp=Slider(0.9, range=0..1),
    sol_absp=Slider(0.7, range=0..1))  # -> mat; plug-in component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
opaquemat_14 = HBOpaqueMaterial(
    name="Cavity (ceiling air)",
    thickness=Slider(0.05, range=0..0.1),
    conductivity=Slider(0.556, range=0..1),
    density=Slider(1.28, range=0..10),
    spec_heat=Slider(1000, range=0..10000),
    therm_absp=Slider(0.9, range=0..1),
    sol_absp=Slider(0.7, range=0..1))  # -> mat; plug-in component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
opaquemat_15 = HBOpaqueMaterial(
    name="IES Insulation Roof",
    thickness=Slider(0.1544, range=0..1),
    conductivity=Slider(0.03, range=0..0.1),
    density=Slider(40, range=0..1000),
    spec_heat=Slider(1450, range=0..10000),
    therm_absp=Slider(0.9, range=0..1),
    sol_absp=Slider(0.7, range=0..1))  # -> mat; plug-in component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
opaquemat_16 = HBOpaqueMaterial(
    name="IES Membrane",
    thickness=Slider(0.0001, range=0..0.1),
    conductivity=Slider(1, range=0..1),
    density=Slider(1100, range=0..10000),
    spec_heat=Slider(1000, range=0..10000),
    therm_absp=Slider(0.9, range=0..1),
    sol_absp=Slider(0.7, range=0..1))  # -> mat; plug-in component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
merge_4 = Merge(Data1=opaquemat_15, Data2=opaquemat_16, Data3=opaquemat_13, Data4=opaquemat_14, Data5=opaquemat_12)
opaqueconstr_5 = HBOpaqueConstruction(name="IES 2013 Roof", materials=merge_4)  # -> constr; plug-in component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

# ----
# Constructions
# Window transmittance
number_slider = Slider(0.7, range=0.1..0.9)

# ----
# WIP - copied from IES external window
# Review note - test between detailed glass set up and simple
number_slider_2 = Slider(0.409, range=0..1)
number_slider_3 = Slider(0.84, range=0..1)
glassmat = HBGlassMaterial(
    thickness=Slider(0.006, range=0.003..0.012),
    transmittance=Slider(0.783, range=0..1),
    reflectance=Slider(0.072, range=0..0.1),
    emiss_front=number_slider_3,
    emiss_back=number_slider_3)  # -> mat; plug-in component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
glassmat_2 = HBGlassMaterial(
    thickness=Slider(0.006, range=0.003..0.012),
    transmittance=number_slider_2,
    reflectance=Slider(0.289, range=0..1),
    emiss_front=Slider(0.84, range=0..1),
    emiss_back=Slider(0.042, range=0..1))  # -> mat; plug-in component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
gapmat = HBWindowGapMaterial(thickness=Slider(0.012, range=0..0.1), gas_types="Argon")  # -> mat; plug-in component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
merge_5 = Merge(Data1=glassmat_2, Data2=gapmat, Data3=glassmat)
windowconstr = HBWindowConstruction(name="IES External Window", materials=merge_5)  # -> constr; plug-in component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
decnstrconstr = HBDeconstructConstruction(constr=windowconstr)  # -> materials, layers, r_val_si, r_val_ip, u_fac_si, u_fac_ip, shgc, t_sol, t_vis; plug-in component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

# ----
# Copied from IES external wall adjusted to U=0.16 (in IES)
panel = Panel("IES Plasterboard")
opaquemat_17 = HBOpaqueMaterial(
    name=panel,
    thickness=Slider(0.0125, range=0..0.1),
    conductivity=Slider(0.21, range=0..1),
    density=Slider(700, range=0..10000),
    spec_heat=Slider(1000, range=0..10000),
    therm_absp=Slider(0.9, range=0..1),
    sol_absp=Slider(0.55, range=0..1))  # -> mat; plug-in component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
opaquemat_18 = HBOpaqueMaterial(
    name="Cavity (wall air)",
    thickness=Slider(0.05, range=0..0.1),
    conductivity=Slider(0.667, range=0..1),
    density=Slider(1.28, range=0..10),
    spec_heat=Slider(1000, range=0..10000),
    therm_absp=Slider(0.9, range=0..1),
    sol_absp=Slider(0.7, range=0..1))  # -> mat; plug-in component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
opaquemat_19 = HBOpaqueMaterial(
    name="IES Insulation Ext Wall",
    thickness=Slider(0.141, range=0..1),
    conductivity=Slider(0.025, range=0..0.1),
    density=Slider(20, range=0..100),
    spec_heat=Slider(1030, range=0..10000),
    therm_absp=Slider(0.9, range=0..1),
    sol_absp=Slider(0.7, range=0..1))  # -> mat; plug-in component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
opaquemat_20 = HBOpaqueMaterial(
    name="IES Cement bonded particle board",
    thickness=Slider(0.012, range=0..1),
    conductivity=Slider(0.23, range=0..1),
    density=Slider(1100, range=0..10000),
    spec_heat=Slider(1000, range=0..10000),
    therm_absp=Slider(0.9, range=0..1),
    sol_absp=Slider(0.7, range=0..1))  # -> mat; plug-in component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
opaquemat_21 = HBOpaqueMaterial(
    name="IES Rainscreen",
    thickness=Slider(0.03, range=0..0.1),
    conductivity=Slider(50, range=0..100),
    density=Slider(7800, range=0..10000),
    spec_heat=Slider(450, range=0..1000),
    therm_absp=Slider(0.9, range=0..1),
    sol_absp=Slider(0.7, range=0..1))  # -> mat; plug-in component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
merge_6 = Merge(Data1=opaquemat_21, Data2=opaquemat_18, Data3=opaquemat_19, Data4=opaquemat_20, Data5=opaquemat_18, Data6=opaquemat_17)
opaqueconstr_6 = HBOpaqueConstruction(name="IES External Wall", materials=merge_6)  # -> constr; plug-in component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
decnstrconstr_2 = HBDeconstructConstruction(constr=opaqueconstr_6)  # -> materials, layers, r_val_si, r_val_ip, u_fac_si, u_fac_ip, shgc, t_sol, t_vis; plug-in component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

# ----
# HB Cavity
searchmats = HBSearchMaterials(keywords="Generic Ceiling Air")  # -> opaque_mats, window_mats; plug-in component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
decnstrmat = HBDeconstructMaterial(mat=searchmats.opaque_mats)  # -> values, attr_names, r_val_si, r_val_ip; plug-in component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
panel_2 = Panel(decnstrmat.values)
panel_3 = Panel(decnstrmat.attr_names)
external_window = Data(windowconstr)
internal_partition = Data(opaqueconstr)
internal_ceiling = Data(opaqueconstr_4)
exposed_floor = Data(opaqueconstr_2)
internal_floor = Data(opaqueconstr_3)
external_wall = Data(opaqueconstr_6)
roof = Data(opaqueconstr_5)

# ----
# Radiance modifiers
glassmod = HBGlassModifier(trans=number_slider)  # -> modifier; plug-in component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
subfacesubset = HBSubfaceModifierSubset(window=glassmod)  # -> subface_set; plug-in component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
modifierset = HBModifierSet(subface_subset=subfacesubset)  # -> mod_set; plug-in component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

subfacesubset_2 = HBSubfaceSubset(window=external_window)  # -> subface_set; plug-in component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
interiorsubset = HBInteriorConstructionSubset(interior_wall=internal_partition, ceiling=internal_ceiling, interior_floor=internal_floor)  # -> interior_set; plug-in component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
groundsubset = HBGroundConstructionSubset(ground_wall=external_wall, ground_roof=roof, ground_floor=exposed_floor)  # -> ground_set; plug-in component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
# Notes
# IES and HB U-values differ for same/similar input.
# This may be due to the way air films are handled between the two - needs investigating
exteriorsubset = HBExteriorConstructionSubset(exterior_wall=external_wall, exterior_roof=roof, exposed_floor=exposed_floor)  # -> exterior_set; plug-in component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
constructionset = HBConstructionSet(
    exterior_subset=exteriorsubset,
    ground_subset=groundsubset,
    interior_subset=interiorsubset,
    subface_subset=subfacesubset_2)  # -> constr_set; plug-in component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

panel_4 = Panel("C:\Users\cbrooker\GitHub\LadybugTools_Toolkit\LadybugTools_Engine\Python\src\ladybugtools_toolkit\prototypes\BoxModel")
falsestart = LBFalseStartToggle(True)
dumpobjects = HBDumpObjects(hb_objs=flatten(constructionset), name="Par_L_2013_ContructionSet", folder=panel_4, dump=falsestart)  # -> report, hb_file; plug-in component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
loadobjects = HBLoadObjects(hb_file=dumpobjects.hb_file, load=Toggle(True))  # -> report, hb_objs; plug-in component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
decnstrconstrset = HBDeconstructConstructionSet(constr_set=loadobjects.hb_objs)  # -> exterior_wall, exterior_roof, exposed_floor, ground_wall, ground_roof, ground_floor, window, skylight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; plug-in component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
