# Grasshopper definition ConstructionSet_from_climate_vintage.gh (Grasshopper 1.0.7)
# plug-ins: BH.UI.Grasshopper

getinfo = GetInfo(Component="{ .GetInfo")
# <Script name>
project_number = Panel("")
setprojectid = SetProjectID(ProjectID=project_number, Component="{ .SetProjectID")
bhom_version_used_to_create = Panel("6.1")
bhom_version_currently_installed = Panel(getinfo)
number_slider = Slider(1, range=0..1)
constrsetclimate = HBConstructionSetByClimate(climate_zone=Slider(8, range=0..10), vintage=Slider(2019, range=0..10000))  # -> constr_set; plug-in component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
decnstrconstrset = HBDeconstructConstructionSet(constr_set=constrsetclimate)  # -> exterior_wall, exterior_roof, exposed_floor, ground_wall, ground_roof, ground_floor, window, skylight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; plug-in component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
decnstrconstr = HBDeconstructConstruction(constr=decnstrconstrset.exterior_wall)  # -> materials, layers, r_val_si, r_val_ip, u_fac_si, u_fac_ip, shgc, t_sol, t_vis; plug-in component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
item = ListItem(List=decnstrconstr.materials, Index=Slider(2, range=0..10), Wrap=True)
panel = Panel(item)
