# Grasshopper definition ConstructConstructionSetGH.gh (Grasshopper 1.0.7)
# plug-ins: BH.UI.Grasshopper

getinfo = GetInfo(Component="{ .GetInfo")
# <Script name>
project_number = Panel("")
setprojectid = SetProjectID(ProjectID=project_number, Component="{ .SetProjectID")
bhom_version_used_to_create = Panel("6.1")
bhom_version_currently_installed = Panel(getinfo)

searchconstrs = HBSearchConstructions(keywords="Generic Interior")  # -> opaque_constrs, window_constrs, shade_constrs; plug-in component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
panel = Panel(searchconstrs.opaque_constrs)
item = ListItem(List=searchconstrs.opaque_constrs, Index=Slider(0, range=0..15), Wrap=True)
panel_2 = Panel(item)
decnstrconstr = HBDeconstructConstruction(constr=item)  # -> materials, layers, r_val_si, r_val_ip, u_fac_si, u_fac_ip, shgc, t_sol, t_vis; plug-in component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
panel_3 = Panel(decnstrconstr.materials)
panel_4 = Panel(decnstrconstr.u_fac_si)

# ----
# to be developed - default HB constructions have bad Tvis Tsol combinations
panel_5 = Panel("Dbl")
searchconstrs_2 = HBSearchConstructions()  # -> opaque_constrs, window_constrs, shade_constrs; plug-in component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
searchconstrs_3 = HBSearchConstructions(keywords="Dbl")  # -> opaque_constrs, window_constrs, shade_constrs; plug-in component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
item_2 = ListItem(List=searchconstrs_2.opaque_constrs, Index=Slider(137, range=0..1000), Wrap=True)
decnstrconstr_2 = HBDeconstructConstruction(constr=item_2)  # -> materials, layers, r_val_si, r_val_ip, u_fac_si, u_fac_ip, shgc, t_sol, t_vis; plug-in component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
panel_6 = Panel(searchconstrs_2.opaque_constrs)
item_3 = ListItem(List=searchconstrs_3.window_constrs, Index=Slider(10, range=0..100), Wrap=True)
item_4 = ListItem(Index=0, Wrap=True)
panel_7 = Panel(decnstrconstr_2.materials)
panel_8 = Panel(item_3)
decnstrconstr_3 = HBDeconstructConstruction(constr=item_3)  # -> materials, layers, r_val_si, r_val_ip, u_fac_si, u_fac_ip, shgc, t_sol, t_vis; plug-in component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
panel_9 = Panel(decnstrconstr_3.u_fac_si)
panel_10 = Panel(decnstrconstr_3.shgc)
panel_11 = Panel(decnstrconstr_3.t_vis)

# ----
# WIP - detailed window construction set up
# Review note - test between detailed glass set up and simple
number_slider = Slider(0.277, range=0..1)
number_slider_2 = Slider(0.84, range=0..1)
glassmat = HBGlassMaterial(
    thickness=Slider(0.006, range=0.003..0.012),
    transmittance=Slider(0.817, range=0..1),
    reflectance=Slider(0.074, range=0..0.1),
    emiss_front=number_slider_2,
    emiss_back=number_slider_2)  # -> mat; plug-in component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
glassmat_2 = HBGlassMaterial(
    thickness=Slider(0.006, range=0.003..0.012),
    transmittance=number_slider,
    reflectance=Slider(0.385, range=0..1),
    emiss_front=Slider(0.84, range=0..1),
    emiss_back=Slider(0.03, range=0..1))  # -> mat; plug-in component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
gapmat = HBWindowGapMaterial(thickness=Slider(0.016, range=0..0.1), gas_types="Argon")  # -> mat; plug-in component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
merge = Merge(Data1=glassmat_2, Data2=gapmat, Data3=glassmat)
windowconstr = HBWindowConstruction(materials=merge)  # -> constr; plug-in component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
decnstrconstr_4 = HBDeconstructConstruction(constr=windowconstr)  # -> materials, layers, r_val_si, r_val_ip, u_fac_si, u_fac_ip, shgc, t_sol, t_vis; plug-in component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

# ----
# Window Material
# Set up a better window construction
number_slider_3 = Slider(1.4, range=0..6)
number_slider_4 = Slider(0.7, range=0.1..0.9)
windowmat = HBWindowMaterial(u_factor=number_slider_3, shgc=Slider(0.285, range=0..1), t_vis=number_slider_4)  # -> mat; plug-in component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

# ----
# Wall Construction
panel_13 = Panel("5/8 in. Gypsum")
target_u_value = Slider(0.6, range=0..1)
# Construction Set Up
panel_14 = Panel("25mm stucco")
searchmats = HBSearchMaterials(keywords=panel_13)  # -> opaque_mats, window_mats; plug-in component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
searchmats_2 = HBSearchMaterials(keywords=panel_14)  # -> opaque_mats, window_mats; plug-in component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
# Review note
# Consider fixing the U-value and apply to both glazing and solid
# Discuss with facades
# At the moment glazing ratio and U-value change are interlinked
one_over_x = OneOverX(Value=target_u_value)
merge_2 = Merge(Data1=searchmats_2.opaque_mats, Data2=searchmats.opaque_mats, Data3=searchmats.opaque_mats)
opaqueconstr = HBOpaqueConstruction(materials=merge_2)  # -> constr; plug-in component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
decnstrconstr_5 = HBDeconstructConstruction(constr=opaqueconstr)  # -> materials, layers, r_val_si, r_val_ip, u_fac_si, u_fac_ip, shgc, t_sol, t_vis; plug-in component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
panel_15 = Panel(decnstrconstr_5.r_val_si)
subtraction = Subtraction(A=one_over_x, B=panel_15)
opaquematnomass = HBOpaqueMaterialNoMass(r_value=subtraction)  # -> mat; plug-in component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
merge_3 = Merge(Data1=searchmats_2.opaque_mats, Data2=searchmats.opaque_mats, Data3=opaquematnomass, Data4=searchmats.opaque_mats)
opaqueconstr_2 = HBOpaqueConstruction(materials=merge_3)  # -> constr; plug-in component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
decnstrconstr_6 = HBDeconstructConstruction(constr=opaqueconstr_2)  # -> materials, layers, r_val_si, r_val_ip, u_fac_si, u_fac_ip, shgc, t_sol, t_vis; plug-in component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

output_opaque_u_value = Panel(decnstrconstr_6.u_fac_si)

# ---- group: Adiabatic
opaqueconstr_3 = HBOpaqueConstruction()  # -> constr; plug-in component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

# ----
# Radiance modifiers
glassmod = HBGlassModifier(trans=number_slider_4)  # -> modifier; plug-in component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
subfacesubset = HBSubfaceModifierSubset(window=glassmod)  # -> subface_set; plug-in component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
modifierset = HBModifierSet(subface_subset=subfacesubset)  # -> mod_set; plug-in component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

# ---- group: Adiabatic
opaqueconstr_4 = HBOpaqueConstruction()  # -> constr; plug-in component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

# ----
opaqueconstr_5 = HBOpaqueConstruction(materials=merge_3)  # -> constr; plug-in component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
subfacesubset_2 = HBSubfaceSubset(window=windowconstr)  # -> subface_set; plug-in component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
interiorsubset = HBInteriorConstructionSubset()  # -> interior_set; plug-in component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
groundsubset = HBGroundConstructionSubset(ground_floor=opaqueconstr_3)  # -> ground_set; plug-in component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
exteriorsubset = HBExteriorConstructionSubset(exterior_wall=opaqueconstr_5, exterior_roof=opaqueconstr_4)  # -> exterior_set; plug-in component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
constructionset = HBConstructionSet(
    exterior_subset=exteriorsubset,
    ground_subset=groundsubset,
    interior_subset=interiorsubset,
    subface_subset=subfacesubset_2)  # -> constr_set; plug-in component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

panel_16 = Panel(decnstrconstr_6.materials)
panel_17 = Panel(opaqueconstr_5)
