# Grasshopper definition ConstructProgramTypeGH_PartLNotionals2021.gh (Grasshopper 1.0.7)
# plug-ins: BH.UI.Grasshopper, LadybugGrasshopper

# ----
# NCM 2013 Notional External Wall
panel = Panel("IES Plasterboard")
opaquemat = HBOpaqueMaterial(
    name=panel,
    thickness=Slider(0.0125, range=0..0.1),
    conductivity=Slider(0.21, range=0..1),
    density=Slider(700, range=0..10000),
    spec_heat=Slider(1000, range=0..10000),
    therm_absp=Slider(0.9, range=0..1),
    sol_absp=Slider(0.55, range=0..1))  # -> mat; plug-in component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
opaquemat_2 = HBOpaqueMaterial(
    name="Cavity (wall air)",
    thickness=Slider(0.05, range=0..0.1),
    conductivity=Slider(0.667, range=0..1),
    density=Slider(1.28, range=0..10),
    spec_heat=Slider(1000, range=0..10000),
    therm_absp=Slider(0.9, range=0..1),
    sol_absp=Slider(0.7, range=0..1))  # -> mat; plug-in component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
opaquemat_3 = HBOpaqueMaterial(
    name="IES Insulation Ext Wall",
    thickness=Slider(0.141, range=0..1),
    conductivity=Slider(0.025, range=0..0.1),
    density=Slider(20, range=0..100),
    spec_heat=Slider(1030, range=0..10000),
    therm_absp=Slider(0.9, range=0..1),
    sol_absp=Slider(0.7, range=0..1))  # -> mat; plug-in component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
opaquemat_4 = HBOpaqueMaterial(
    name="IES Cement bonded particle board",
    thickness=Slider(0.012, range=0..1),
    conductivity=Slider(0.23, range=0..1),
    density=Slider(1100, range=0..10000),
    spec_heat=Slider(1000, range=0..10000),
    therm_absp=Slider(0.9, range=0..1),
    sol_absp=Slider(0.7, range=0..1))  # -> mat; plug-in component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
opaquemat_5 = HBOpaqueMaterial(
    name="IES Rainscreen",
    thickness=Slider(0.003, range=0..0.01),
    conductivity=Slider(50, range=0..100),
    density=Slider(7800, range=0..10000),
    spec_heat=Slider(450, range=0..1000),
    therm_absp=Slider(0.9, range=0..1),
    sol_absp=Slider(0.7, range=0..1))  # -> mat; plug-in component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
merge = Merge(Data1=opaquemat_5, Data2=opaquemat_2, Data3=opaquemat_3, Data4=opaquemat_4, Data5=opaquemat_2, Data6=opaquemat)
opaqueconstr = HBOpaqueConstruction(name="IES External Wall", materials=merge)  # -> constr; plug-in component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
decnstrconstr = HBDeconstructConstruction(constr=opaqueconstr)  # -> materials, layers, r_val_si, r_val_ip, u_fac_si, u_fac_ip, shgc, t_sol, t_vis; plug-in component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

getinfo = GetInfo(Component="{ .GetInfo")
# <Script name>
project_number = Panel("")
setprojectid = SetProjectID(ProjectID=project_number, Component="{ .SetProjectID")
bhom_version_used_to_create = Panel("6.0")
bhom_version_currently_installed = Panel(getinfo)

# ----
# Pull constructuions from IES
panel_2 = Panel("C:\Users\cbrooker\Desktop\IES\BoxModelValidation\Pull Constructions\Pull Constructions_ConstructionsData.json")
readfromjsonfile = ReadFromJsonFile(FilePath=panel_2, Active=Toggle(True), Component="{ .ReadFromJsonFile")
explode = Explode(Object=readfromjsonfile, Component="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")  # -> Constructions, Has_constructions, Has_materials, Project_name, Project_path, Project_title, Name, Tags, BHoM_Guid
explode_2 = Explode(Object=explode.Constructions, Component="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")  # -> Construction_category, Construction_id, Construction_name, Construction_thickness, Is_opaque, Layers, Resistances, Uvalue_ashrae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
explode_3 = Explode(Object=explode_2.Layers, Component="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")  # -> Layer_id, Layer_properties, Material_id, Material_properties, Name, Tags, BHoM_Guid
tmatch = MatchText(Text=explode_2.Construction_name, RegEx="NCM", Case=True)
cull = CullPattern(List=explode.Constructions, CullPattern=tmatch)
panel_3 = Panel(explode_3.Layer_id)
explode_4 = Explode(Object=cull, Component="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")  # -> Construction_category, Construction_id, Construction_name, G_value, Is_opaque, Long_wave_shading_coefficient, Resistances, Shgc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
explode_5 = Explode(Object=explode_3.Material_properties, Component="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")  # -> Category, Conductivity, Density, Description, Id, Specific_heat_capacity, Thickness, Vapour_resistivity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

opaquemat_6 = HBOpaqueMaterial(
    name="IES Plasterboard",
    thickness=Slider(0.0125, range=0..0.1),
    conductivity=Slider(0.21, range=0..1),
    density=Slider(700, range=0..10000),
    spec_heat=Slider(1000, range=0..10000),
    therm_absp=Slider(0.9, range=0..1),
    sol_absp=Slider(0.55, range=0..1))  # -> mat; plug-in component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
opaquemat_7 = HBOpaqueMaterial(
    name="Cavity (wall air)",
    thickness=Slider(0.05, range=0..0.1),
    conductivity=Slider(0.667, range=0..1),
    density=Slider(1.28, range=0..10),
    spec_heat=Slider(1000, range=0..10000),
    therm_absp=Slider(0.9, range=0..1),
    sol_absp=Slider(0.7, range=0..1))  # -> mat; plug-in component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
merge_2 = Merge(Data1=opaquemat_6, Data2=opaquemat_7, Data3=opaquemat_6)
opaqueconstr_2 = HBOpaqueConstruction(name="IES Internal Partition", materials=merge_2)  # -> constr; plug-in component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

opaquemat_8 = HBOpaqueMaterial(
    name="Cavity (ceiling air)",
    thickness=Slider(0.05, range=0..0.1),
    conductivity=Slider(0.556, range=0..1),
    density=Slider(1.28, range=0..10),
    spec_heat=Slider(1000, range=0..10000),
    therm_absp=Slider(0.9, range=0..1),
    sol_absp=Slider(0.7, range=0..1))  # -> mat; plug-in component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
opaquemat_9 = HBOpaqueMaterial(
    name="IES Chipboard Flooring",
    thickness=Slider(0.0982, range=0..0.1),
    conductivity=Slider(0.025, range=0..0.1),
    density=Slider(700, range=0..1000),
    spec_heat=Slider(1000, range=0..10000),
    therm_absp=Slider(0.9, range=0..1),
    sol_absp=Slider(0.55, range=0..1))  # -> mat; plug-in component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
opaquemat_10 = HBOpaqueMaterial(
    name="IES Insulation Exposed Floor",
    thickness=Slider(0.0982, range=0..0.1),
    conductivity=Slider(0.025, range=0..0.1),
    density=Slider(700, range=0..1000),
    spec_heat=Slider(1000, range=0..10000),
    therm_absp=Slider(0.9, range=0..1),
    sol_absp=Slider(0.7, range=0..1))  # -> mat; plug-in component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
opaquemat_11 = HBOpaqueMaterial(
    name="IES Reinforced Concrete",
    thickness=Slider(0.1, range=0..0.1),
    conductivity=Slider(2.3, range=0..10),
    density=Slider(2300, range=0..10000),
    spec_heat=Slider(1000, range=0..10000),
    therm_absp=Slider(0.9, range=0..1),
    sol_absp=Slider(0.7, range=0..1))  # -> mat; plug-in component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
merge_3 = Merge(Data1=opaquemat_10, Data2=opaquemat_11, Data3=opaquemat_8, Data4=opaquemat_9)
opaqueconstr_3 = HBOpaqueConstruction(name="IES 2013 Exposed Floor", materials=merge_3)  # -> constr; plug-in component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

opaquemat_12 = HBOpaqueMaterial(
    name="IES Screed",
    thickness=Slider(0.05, range=0..0.1),
    conductivity=Slider(1.15, range=0..10),
    density=Slider(1800, range=0..10000),
    spec_heat=Slider(1000, range=0..10000),
    therm_absp=Slider(0.9, range=0..1),
    sol_absp=Slider(0.7, range=0..1))  # -> mat; plug-in component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
opaquemat_13 = HBOpaqueMaterial(
    name="Cavity (ceiling air)",
    thickness=Slider(0.05, range=0..0.1),
    conductivity=Slider(0.556, range=0..1),
    density=Slider(1.28, range=0..10),
    spec_heat=Slider(1000, range=0..10000),
    therm_absp=Slider(0.9, range=0..1),
    sol_absp=Slider(0.7, range=0..1))  # -> mat; plug-in component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
opaquemat_14 = HBOpaqueMaterial(
    name="IES Chipboard Flooring",
    thickness=Slider(0.0982, range=0..0.1),
    conductivity=Slider(0.025, range=0..0.1),
    density=Slider(700, range=0..1000),
    spec_heat=Slider(1000, range=0..10000),
    therm_absp=Slider(0.9, range=0..1),
    sol_absp=Slider(0.55, range=0..1))  # -> mat; plug-in component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
opaquemat_15 = HBOpaqueMaterial(
    name="IES Plasterboard",
    thickness=Slider(0.0125, range=0..0.1),
    conductivity=Slider(0.21, range=0..1),
    density=Slider(700, range=0..10000),
    spec_heat=Slider(1000, range=0..10000),
    therm_absp=Slider(0.9, range=0..1),
    sol_absp=Slider(0.55, range=0..1))  # -> mat; plug-in component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
opaquemat_16 = HBOpaqueMaterial(
    name="IES Reinforced Concrete",
    thickness=Slider(0.1, range=0..0.1),
    conductivity=Slider(2.3, range=0..10),
    density=Slider(2300, range=0..10000),
    spec_heat=Slider(1000, range=0..10000),
    therm_absp=Slider(0.9, range=0..1),
    sol_absp=Slider(0.7, range=0..1))  # -> mat; plug-in component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
merge_4 = Merge(Data1=opaquemat_14, Data2=opaquemat_13, Data3=opaquemat_12, Data4=opaquemat_16, Data5=opaquemat_13, Data6=opaquemat_15)
data = Data(reverse(merge_4))
opaqueconstr_4 = HBOpaqueConstruction(name="IES 2013 Floor", materials=data)  # -> constr; plug-in component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
opaqueconstr_5 = HBOpaqueConstruction(name="IES 2013 Ceiling", materials=merge_4)  # -> constr; plug-in component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

opaquemat_17 = HBOpaqueMaterial(
    name="IES Plasterboard",
    thickness=Slider(0.0125, range=0..0.1),
    conductivity=Slider(0.21, range=0..1),
    density=Slider(700, range=0..10000),
    spec_heat=Slider(1000, range=0..10000),
    therm_absp=Slider(0.9, range=0..1),
    sol_absp=Slider(0.55, range=0..1))  # -> mat; plug-in component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
opaquemat_18 = HBOpaqueMaterial(
    name="IES Concrete Deck",
    thickness=Slider(0.1, range=0..0.1),
    conductivity=Slider(2, range=0..10),
    density=Slider(2400, range=0..10000),
    spec_heat=Slider(1000, range=0..10000),
    therm_absp=Slider(0.9, range=0..1),
    sol_absp=Slider(0.7, range=0..1))  # -> mat; plug-in component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
opaquemat_19 = HBOpaqueMaterial(
    name="Cavity (ceiling air)",
    thickness=Slider(0.05, range=0..0.1),
    conductivity=Slider(0.556, range=0..1),
    density=Slider(1.28, range=0..10),
    spec_heat=Slider(1000, range=0..10000),
    therm_absp=Slider(0.9, range=0..1),
    sol_absp=Slider(0.7, range=0..1))  # -> mat; plug-in component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
opaquemat_20 = HBOpaqueMaterial(
    name="IES Insulation Roof",
    thickness=Slider(0.1544, range=0..1),
    conductivity=Slider(0.03, range=0..0.1),
    density=Slider(40, range=0..1000),
    spec_heat=Slider(1450, range=0..10000),
    therm_absp=Slider(0.9, range=0..1),
    sol_absp=Slider(0.7, range=0..1))  # -> mat; plug-in component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
opaquemat_21 = HBOpaqueMaterial(
    name="IES Membrane",
    thickness=Slider(0.0001, range=0..0.1),
    conductivity=Slider(1, range=0..1),
    density=Slider(1100, range=0..10000),
    spec_heat=Slider(1000, range=0..10000),
    therm_absp=Slider(0.9, range=0..1),
    sol_absp=Slider(0.7, range=0..1))  # -> mat; plug-in component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
merge_5 = Merge(Data1=opaquemat_20, Data2=opaquemat_21, Data3=opaquemat_18, Data4=opaquemat_19, Data5=opaquemat_17)
opaqueconstr_6 = HBOpaqueConstruction(name="IES 2013 Roof", materials=merge_5)  # -> constr; plug-in component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

# ----
# Window transmittance
number_slider = Slider(0.7, range=0.1..0.9)

# ----
# Constructions
# Window transmittance
number_slider_2 = Slider(0.7, range=0.1..0.9)

# ----
# WIP - copied from IES external window
# Review note - test between detailed glass set up and simple
number_slider_3 = Slider(0.409, range=0..1)
number_slider_4 = Slider(0.84, range=0..1)
glassmat = HBGlassMaterial(
    thickness=Slider(0.006, range=0.003..0.012),
    transmittance=Slider(0.783, range=0..1),
    reflectance=Slider(0.072, range=0..0.1),
    emiss_front=number_slider_4,
    emiss_back=number_slider_4)  # -> mat; plug-in component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
glassmat_2 = HBGlassMaterial(
    thickness=Slider(0.006, range=0.003..0.012),
    transmittance=number_slider_3,
    reflectance=Slider(0.289, range=0..1),
    emiss_front=Slider(0.84, range=0..1),
    emiss_back=Slider(0.042, range=0..1))  # -> mat; plug-in component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
gapmat = HBWindowGapMaterial(thickness=Slider(0.012, range=0..0.1), gas_types="Argon")  # -> mat; plug-in component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
merge_6 = Merge(Data1=glassmat_2, Data2=gapmat, Data3=glassmat)
windowconstr = HBWindowConstruction(name="IES External Window", materials=merge_6)  # -> constr; plug-in component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
decnstrconstr_2 = HBDeconstructConstruction(constr=windowconstr)  # -> materials, layers, r_val_si, r_val_ip, u_fac_si, u_fac_ip, shgc, t_sol, t_vis; plug-in component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

# ----
# WIP - copied from IES external window
# Review note - test between detailed glass set up and simple
number_slider_5 = Slider(0.409, range=0..1)
number_slider_6 = Slider(0.84, range=0..1)
glassmat_3 = HBGlassMaterial(
    thickness=Slider(0.006, range=0.003..0.012),
    transmittance=Slider(0.783, range=0..1),
    reflectance=Slider(0.072, range=0..0.1),
    emiss_front=number_slider_6,
    emiss_back=number_slider_6)  # -> mat; plug-in component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
# Part L Notional 2013
glassmat_4 = HBGlassMaterial(
    thickness=Slider(0.006, range=0.003..0.012),
    transmittance=number_slider_5,
    reflectance=Slider(0.289, range=0..1),
    emiss_front=Slider(0.837, range=0..1),
    emiss_back=Slider(0.042, range=0..1))  # -> mat; plug-in component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
gapmat_2 = HBWindowGapMaterial(thickness=Slider(0.012, range=0..0.1), gas_types="Argon")  # -> mat; plug-in component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
merge_7 = Merge(Data1=glassmat_4, Data2=gapmat_2, Data3=glassmat_3)
windowconstr_2 = HBWindowConstruction(name="IES External Window", materials=merge_7)  # -> constr; plug-in component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
decnstrconstr_3 = HBDeconstructConstruction(constr=windowconstr_2)  # -> materials, layers, r_val_si, r_val_ip, u_fac_si, u_fac_ip, shgc, t_sol, t_vis; plug-in component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

# ----
# NCM 2021 Notional External Wall (sidelit/unlit)
panel_4 = Panel("IES Plasterboard")
opaquemat_22 = HBOpaqueMaterial(
    name=panel_4,
    thickness=Slider(0.0125, range=0..0.1),
    conductivity=Slider(0.21, range=0..1),
    density=Slider(700, range=0..10000),
    spec_heat=Slider(1000, range=0..10000),
    therm_absp=Slider(0.9, range=0..1),
    sol_absp=Slider(0.55, range=0..1))  # -> mat; plug-in component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
opaquemat_23 = HBOpaqueMaterial(
    name="Cavity (wall air)",
    thickness=Slider(0.05, range=0..0.1),
    conductivity=Slider(0.667, range=0..1),
    density=Slider(1.28, range=0..10),
    spec_heat=Slider(1000, range=0..10000),
    therm_absp=Slider(0.9, range=0..1),
    sol_absp=Slider(0.7, range=0..1))  # -> mat; plug-in component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
opaquemat_24 = HBOpaqueMaterial(
    name="IES Insulation Ext Wall",
    thickness=Slider(0.141, range=0..1),
    conductivity=Slider(0.025, range=0..0.1),
    density=Slider(20, range=0..100),
    spec_heat=Slider(1030, range=0..10000),
    therm_absp=Slider(0.9, range=0..1),
    sol_absp=Slider(0.7, range=0..1))  # -> mat; plug-in component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
opaquemat_25 = HBOpaqueMaterial(
    name="IES Cement bonded particle board",
    thickness=Slider(0.012, range=0..1),
    conductivity=Slider(0.23, range=0..1),
    density=Slider(1100, range=0..10000),
    spec_heat=Slider(1000, range=0..10000),
    therm_absp=Slider(0.9, range=0..1),
    sol_absp=Slider(0.7, range=0..1))  # -> mat; plug-in component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
opaquemat_26 = HBOpaqueMaterial(
    name="IES Rainscreen",
    thickness=Slider(0.03, range=0..0.1),
    conductivity=Slider(50, range=0..100),
    density=Slider(7800, range=0..10000),
    spec_heat=Slider(450, range=0..1000),
    therm_absp=Slider(0.9, range=0..1),
    sol_absp=Slider(0.7, range=0..1))  # -> mat; plug-in component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
merge_8 = Merge(Data1=opaquemat_26, Data2=opaquemat_23, Data3=opaquemat_24, Data4=opaquemat_25, Data5=opaquemat_23, Data6=opaquemat_22)
opaqueconstr_7 = HBOpaqueConstruction(name="IES External Wall", materials=merge_8)  # -> constr; plug-in component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
decnstrconstr_4 = HBDeconstructConstruction(constr=opaqueconstr_7)  # -> materials, layers, r_val_si, r_val_ip, u_fac_si, u_fac_ip, shgc, t_sol, t_vis; plug-in component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

# ----
# NCM 2021 Notional External Wall (sidelit/unlit)
panel_5 = Panel("IES Cellular Polyisocyanurate - 110mm")
opaquemat_27 = HBOpaqueMaterial(
    name="Cavity (wall air)",
    thickness=Slider(0.04, range=0..0.1),
    conductivity=Slider(0.667, range=0..1),
    density=Slider(1.28, range=0..10),
    spec_heat=Slider(1000, range=0..10000),
    therm_absp=Slider(0.9, range=0..1),
    sol_absp=Slider(0.7, range=0..1))  # -> mat; plug-in component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
opaquemat_28 = HBOpaqueMaterial(
    name="IES Concrete Block (Heavyweight) Outer",
    thickness=Slider(0.1, range=0..1),
    conductivity=Slider(1.13, range=0..10),
    density=Slider(2300, range=0..10000),
    spec_heat=Slider(1000, range=0..10000),
    therm_absp=Slider(0.9, range=0..1),
    sol_absp=Slider(0.7, range=0..1))  # -> mat; plug-in component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
opaquemat_29 = HBOpaqueMaterial(
    name=panel_5,
    thickness=Slider(0.11, range=0..1),
    conductivity=Slider(0.0224, range=0..0.1),
    density=Slider(32, range=0..10000),
    spec_heat=Slider(900, range=0..10000),
    therm_absp=Slider(0.9, range=0..1),
    sol_absp=Slider(0.7, range=0..1))  # -> mat; plug-in component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
opaquemat_30 = HBOpaqueMaterial(
    name="IES Concrete Block (Heavyweight) Inner",
    thickness=Slider(0.1, range=0..1),
    conductivity=Slider(1.63, range=0..10),
    density=Slider(2300, range=0..10000),
    spec_heat=Slider(1000, range=0..10000),
    therm_absp=Slider(0.9, range=0..1),
    sol_absp=Slider(0.7, range=0..1))  # -> mat; plug-in component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
opaquemat_31 = HBOpaqueMaterial(
    name="IES External Rendering",
    thickness=Slider(0.019, range=0..0.1),
    conductivity=Slider(0.8, range=0..1),
    density=Slider(1300, range=0..10000),
    spec_heat=Slider(1000, range=0..1000),
    therm_absp=Slider(0.9, range=0..1),
    sol_absp=Slider(0.7, range=0..1))  # -> mat; plug-in component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
opaquemat_32 = HBOpaqueMaterial(
    name="IES Gypsum Plastering",
    thickness=Slider(0.0217, range=0..0.1),
    conductivity=Slider(0.42, range=0..1),
    density=Slider(1200, range=0..10000),
    spec_heat=Slider(837, range=0..10000),
    therm_absp=Slider(0.9, range=0..1),
    sol_absp=Slider(0.55, range=0..1))  # -> mat; plug-in component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
opaquemat_33 = HBOpaqueMaterial(
    name="IES Cellular Polyisocyanurate - 2mm",
    thickness=Slider(0.002, range=0..0.01),
    conductivity=Slider(0.04, range=0..0.1),
    density=Slider(32, range=0..10000),
    spec_heat=Slider(900, range=0..10000),
    therm_absp=Slider(0.9, range=0..1),
    sol_absp=Slider(0.7, range=0..1))  # -> mat; plug-in component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
merge_9 = Merge(
    Data1=opaquemat_31,
    Data2=opaquemat_28,
    Data3=opaquemat_27,
    Data4=opaquemat_29,
    Data5=opaquemat_30,
    Data6=opaquemat_33,
    Data7=opaquemat_32)
opaqueconstr_8 = HBOpaqueConstruction(name="IES External Wall", materials=merge_9)  # -> constr; plug-in component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
decnstrconstr_5 = HBDeconstructConstruction(constr=opaqueconstr_8)  # -> materials, layers, r_val_si, r_val_ip, u_fac_si, u_fac_ip, shgc, t_sol, t_vis; plug-in component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

panel_6 = Panel(decnstrconstr_3.r_val_si)
# HB Cavity
panel_7 = Panel(decnstrconstr_4.u_fac_si)
searchmats = HBSearchMaterials(keywords="Generic Ceiling Air")  # -> opaque_mats, window_mats; plug-in component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
falsestart = LBFalseStartToggle(True)
panel_8 = Panel(decnstrconstr_5.u_fac_si)
dumpobjects = HBDumpObjects(
    hb_objs=flatten(opaqueconstr_8),
    name="Construction_HB_Example_Wall",
    folder="C:\Users\cbrooker\Desktop\Box_Model",
    dump=falsestart)  # -> report, hb_file; plug-in component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
decnstrmat = HBDeconstructMaterial(mat=searchmats.opaque_mats)  # -> values, attr_names, r_val_si, r_val_ip; plug-in component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
panel_9 = Panel(decnstrmat.values)
panel_10 = Panel(decnstrmat.attr_names)
external_window = Data(windowconstr)
internal_partition = Data(opaqueconstr_2)
internal_ceiling = Data(opaqueconstr_5)
exposed_floor = Data(opaqueconstr_3)
internal_floor = Data(opaqueconstr_4)
external_wall = Data(opaqueconstr_8)
roof = Data(opaqueconstr_6)

# ----
# Radiance modifiers
glassmod = HBGlassModifier(trans=number_slider_2)  # -> modifier; plug-in component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
subfacesubset = HBSubfaceModifierSubset(window=glassmod)  # -> subface_set; plug-in component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
modifierset = HBModifierSet(subface_subset=subfacesubset)  # -> mod_set; plug-in component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

subfacesubset_2 = HBSubfaceSubset(window=external_window)  # -> subface_set; plug-in component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
interiorsubset = HBInteriorConstructionSubset(interior_wall=internal_partition, ceiling=internal_ceiling, interior_floor=internal_floor)  # -> interior_set; plug-in component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
groundsubset = HBGroundConstructionSubset(ground_wall=external_wall, ground_roof=roof, ground_floor=exposed_floor)  # -> ground_set; plug-in component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
# Notes
# IES and HB U-values differ for same/similar input.
# This may be due to the way air films are handled between the two - needs investigating
exteriorsubset = HBExteriorConstructionSubset(exterior_wall=external_wall, exterior_roof=roof, exposed_floor=exposed_floor)  # -> exterior_set; plug-in component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
constructionset = HBConstructionSet(
    exterior_subset=exteriorsubset,
    ground_subset=groundsubset,
    interior_subset=interiorsubset,
    subface_subset=subfacesubset_2)  # -> constr_set; plug-in component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
