# Grasshopper definition GrasshopperTestingAlongside.gh (Grasshopper 1.0.7)
# plug-ins: BH.UI.Grasshopper

getinfo = GetInfo(Component="{ .GetInfo")
# <Script name>
project_number = Panel("")
setprojectid = SetProjectID(ProjectID=project_number, Component="{ .SetProjectID")
bhom_version_used_to_create = Panel("6.1")
bhom_version_currently_installed = Panel(getinfo)
brep = Brep(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)
toggle = BooleanToggle(True)
roomsolid = HBRoomFromSolid(geo=flatten(brep), conditioned=True)  # -> report, rooms; plug-in component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
number_slider = Slider(0, range=0..100)
simoutput = HBSimulationOutput(
    zone_energy_use=toggle,
    gains_and_losses=toggle,
    comfort_metrics=toggle,
    surface_energy_flow=toggle,
    load_type="Sensible")  # -> report, sim_output; plug-in component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
bldgprograms = HBBuildingPrograms({"LargeOffice", "MediumOffice", "SmallOffice", "MidriseApartment", "HighriseApartment", "Retail", "StripMall", "PrimarySchool", "SecondarySchool", "SmallHotel", "LargeHotel", "Hospital", "Outpatient", "Laboratory", "Warehouse", "SuperMarket", "FullServiceRestaurant", "QuickServiceRestaurant", "Courthouse", "LargeDataCenterHighITE", "LargeDataCenterLowITE", "SmallDataCenterHighITE", "SmallDataCenterLowITE"}, selected="LargeOffice")
applyprogram = HBApplyProgramType(rooms=flatten(roomsolid.rooms))  # -> report, rooms; plug-in component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
panel = Panel("C:\Program Files\IES\Shared Content\Weather\SAU_Riyadh.404380_IWEC.epw")
idealair = HBIdealAir(
    rooms=flatten(roomsolid.rooms),
    economizer="NoEconomizer",
    dcv=Toggle(False),
    sensible_hr=number_slider,
    latent_hr=number_slider,
    heat_limit="NoLimit",
    cool_limit="NoLimit")  # -> report, rooms; plug-in component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
shadowcalc = HBShadowCalculation()  # -> shadow_calc; plug-in component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
searchprog = HBSearchPrograms(bldg_prog=bldgprograms, keywords="OpenOffice")  # -> room_prog; plug-in component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
model = HBModel(rooms=flatten(idealair.rooms))  # -> report, model; plug-in component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
panel_2 = Panel(simoutput.sim_output)
deconstrprogram = HBDeconstructProgramType(program=searchprog)  # -> people, lighting, electric_equip, gas_equip, hot_water, infiltration, ventilation, setpoint; plug-in component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
simpar = HBSimulationParameter(north=Slider(0, range=0..100), output=simoutput.sim_output, timestep=6)  # -> sim_par; plug-in component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
toggle_2 = BooleanToggle(True)
decnstrequipment = HBDeconstructEquipment(equip=deconstrprogram.electric_equip)  # -> name, watts_per_area, schedule, radiant_fract, latent_fract, lost_fract, is_gas; plug-in component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
decnstrpeople = HBDeconstructPeople(people=deconstrprogram.people)  # -> name, ppl_per_area, occupancy_sch, activity_sch; plug-in component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
decnstrlighting = HBDeconstructLighting(lighting=deconstrprogram.lighting)  # -> name, watts_per_area, schedule, radiant_fract, visible_fract, return_fract, baseline; plug-in component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
modeltoosm = HBModelToOSM(model=model.model, epw_file=panel, sim_par=simpar, write=toggle_2, run=toggle_2)  # -> report, jsons, osw, osm, idf, sql, zsz, rdd, html; plug-in component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
one_over_x = OneOverX(Value=decnstrpeople.ppl_per_area)
schtodata = HBScheduleToData(schedule=decnstrequipment.schedule)  # -> data; plug-in component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
panel_3 = Panel(one_over_x)
roomcomfortresult = HBReadRoomComfortResult(sql=modeltoosm.sql)  # -> oper_temp, air_temp, rad_temp, rel_humidity; plug-in component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
roomenergyresult = HBReadRoomEnergyResult(sql=modeltoosm.sql)  # -> cooling, heating, lighting, electric_equip, gas_equip, process, hot_water, fan_electric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; plug-in component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
hourlyplot = LBHourlyPlot(data=schtodata)  # -> report, mesh, legend, borders, labels, title, vis_set; plug-in component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
normbyflr = HBNormalizeByFloorArea(data=roomenergyresult.cooling, model=model.model)  # -> total_data, room_data; plug-in component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
hourlyplot_2 = LBHourlyPlot(data=roomcomfortresult.air_temp)  # -> report, mesh, legend, borders, labels, title, vis_set; disabled; plug-in component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
rate = LBTimeRateOfChange(data=normbyflr.room_data)  # -> data_rate; plug-in component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
units = LBUnitConverter(values=normbyflr.room_data)  # -> all_u, values; plug-in component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
