# Grasshopper definition unnamed.gh (Grasshopper 1.0.7)
# plug-ins: BH.UI.Grasshopper

getinfo = GetInfo(Component="{ .GetInfo")
# <Script name>
project_number = Panel("")
setprojectid = SetProjectID(ProjectID=project_number, Component="{ .SetProjectID")
bhom_version_used_to_create = Panel("6.0")
bhom_version_currently_installed = Panel(getinfo)
rectangle = Rectangle(Plane=PlaneXY(0, 0, 0), XSize="-10 to 10", YSize="-10 to 10", Radius=0)  # -> Rectangle, Length
pop2d = Populate2D(Region=rectangle.Rectangle, Count="10", Seed="4")
scale = Scale(Geometry=rectangle.Rectangle, Center=Point(0, 0, 0), Factor="2")  # -> Geometry, Transform
scale_2 = Scale(Geometry=rectangle.Rectangle, Center=Point(0, 0, 0), Factor="1.5")  # -> Geometry, Transform
Z = UnitZ(Factor="4")
move = Move(Geometry=pop2d, Motion=Z)  # -> Geometry, Transform
boundary = BoundarySurfaces(Edges=scale_2.Geometry)
boundary_2 = BoundarySurfaces(Edges=scale.Geometry)
msphere = MeshSphere(Base=move.Geometry, Radius="2.5", UCount=10, VCount=20)
partition = PartitionList(List=msphere, Size="2")
panel = Panel("C:\Users\tgerrish\Documents\GitHub\BHoM\LadybugTools_Toolkit\LadybugTools_Engine\Python\src\ladybugtools_toolkit\prototypes\vegetation_rad")
flip = FlipMatrix(Data=partition)
genpts = LBGeneratePointGrid(geometry=boundary, grid_size="2", offset_dist="1.2")  # -> points, vectors, face_areas, mesh; plug-in component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
glassmod = HBGlassModifier(name="veg_deciduous", trans="0.5")  # -> modifier; plug-in component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
glassmod_2 = HBGlassModifier(name="veg_nondeciduous", trans="0.5")  # -> modifier; plug-in component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
bang = ExplodeTree(Data=flip)  # -> Branch0, Branch1
face = HBFace(geo=bang.Branch0, rad_mod=glassmod)  # -> report, faces; plug-in component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
face_2 = HBFace(geo=boundary_2, name="ground")  # -> report, faces; plug-in component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
face_3 = HBFace(geo=bang.Branch1, rad_mod=glassmod_2)  # -> report, faces; plug-in component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
merge = Merge(Data1=face.faces, Data2=face_3.faces, Data3=face_2.faces)
sensorgrid = HBSensorGrid(positions=genpts.points)  # -> grid; plug-in component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
model = HBModel(faces=flatten(merge), name="seasonal_leaf_cover")  # -> report, model; plug-in component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
assigngridsviews = HBAssignGridsAndViews(model=model.model, grids=flatten(sensorgrid))  # -> model; plug-in component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
dumpobjects = HBDumpObjects(hb_objs=flatten(assigngridsviews), name="seasonal_leaf_cover", folder=panel, dump=Toggle(True))  # -> report, hb_file; plug-in component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
