# Grasshopper definition SpatialComfort.gh (Grasshopper 1.0.7)
# plug-ins: BH.UI.Grasshopper, Human, LadybugGrasshopper

getinfo = GetInfo(Component="{ .GetInfo")
# <Script name>
project_number = Panel("")
setprojectid = SetProjectID(ProjectID=project_number, Component="{ .SetProjectID")
bhom_version_used_to_create = Panel("5.1")
bhom_version_currently_installed = Panel(getinfo)
dpipeline = DynamicGeometryPipeline(
    LayerFilter="VEGETATION::TREE",
    TypeFilter="Mesh",
    NameFilter="*",
    GroupByLayer=False,
    GroupByType=False,
    IncludeHidden=True,
    IncludeLocked=True,
    enableFullPath=True,
    listenToAttributes=True)
demesh = DeconstructMesh(Mesh=dpipeline)  # -> Vertices, Faces, Colours, Normals
dpipeline_2 = DynamicGeometryPipeline(
    LayerFilter="*_GND",
    TypeFilter="All",
    NameFilter="*",
    GroupByLayer=False,
    GroupByType=False,
    IncludeHidden=True,
    IncludeLocked=True,
    enableFullPath=False,
    listenToAttributes=True)
lng = ListLength(List=simplify(demesh.Faces))
dpipeline_3 = DynamicGeometryPipeline(
    LayerFilter="WATER::SOURCE",
    TypeFilter="Point",
    NameFilter="*",
    GroupByLayer=False,
    GroupByType=False,
    IncludeHidden=True,
    IncludeLocked=True,
    enableFullPath=True,
    listenToAttributes=True)
dpipeline_4 = DynamicGeometryPipeline(
    LayerFilter="WATER::BODY_GND",
    TypeFilter="Brep",
    NameFilter="*",
    GroupByLayer=False,
    GroupByType=False,
    IncludeHidden=True,
    IncludeLocked=True,
    enableFullPath=True,
    listenToAttributes=True)
dpipeline_5 = DynamicGeometryPipeline(
    LayerFilter="VEGETATION::GRASS_GND",
    TypeFilter="Brep",
    NameFilter="*",
    GroupByLayer=False,
    GroupByType=False,
    IncludeHidden=True,
    IncludeLocked=True,
    enableFullPath=True,
    listenToAttributes=True)
lng_2 = ListLength(List=dpipeline_2)
dpipeline_6 = DynamicGeometryPipeline(
    LayerFilter="GROUND::ASPHALT_GND",
    TypeFilter="Brep",
    NameFilter="*",
    GroupByLayer=False,
    GroupByType=False,
    IncludeHidden=True,
    IncludeLocked=True,
    enableFullPath=True,
    listenToAttributes=True)
dpipeline_7 = DynamicGeometryPipeline(
    LayerFilter="CONTEXT::FENCE",
    TypeFilter="Brep",
    NameFilter="*",
    GroupByLayer=False,
    GroupByType=False,
    IncludeHidden=True,
    IncludeLocked=True,
    enableFullPath=True,
    listenToAttributes=True)
series = Series(Start=0, Step=1, Count=lng)
dpipeline_8 = DynamicGeometryPipeline(
    LayerFilter="CONTEXT::BUILDING",
    TypeFilter="Brep",
    NameFilter="*",
    GroupByLayer=False,
    GroupByType=False,
    IncludeHidden=True,
    IncludeLocked=True,
    enableFullPath=True,
    listenToAttributes=True)
dpipeline_9 = DynamicGeometryPipeline(
    LayerFilter="CONTEXT::FABRIC",
    TypeFilter="Mesh",
    NameFilter="*",
    GroupByLayer=False,
    GroupByType=False,
    IncludeHidden=True,
    IncludeLocked=True,
    enableFullPath=True,
    listenToAttributes=True)
dpipeline_10 = DynamicGeometryPipeline(
    LayerFilter="GROUND::CONCRETE_GND",
    TypeFilter="Brep",
    NameFilter="*",
    GroupByLayer=False,
    GroupByType=False,
    IncludeHidden=True,
    IncludeLocked=True,
    enableFullPath=True,
    listenToAttributes=True)
panel = Panel("""1
2""")
dpipeline_11 = DynamicGeometryPipeline(
    LayerFilter="GROUND::TRAVERTINE_GND",
    TypeFilter="Brep",
    NameFilter="*",
    GroupByLayer=False,
    GroupByType=False,
    IncludeHidden=True,
    IncludeLocked=True,
    enableFullPath=True,
    listenToAttributes=True)
series_2 = Series(Start=0, Step=1, Count=lng_2)
jitter = Jitter(List=series, Jitter=1, Seed=graft(panel))  # -> Values, Indices
face = HBFace(geo=dpipeline_5, name="VEGETATION::GRASS_GND")  # -> report, faces; plug-in component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
face_2 = HBFace(geo=dpipeline_6, name="GROUND::ASPHALT_GND")  # -> report, faces; plug-in component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
face_3 = HBFace(geo=dpipeline_10, name="GROUND::CONCRETE_GND")  # -> report, faces; plug-in component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
face_4 = HBFace(geo=dpipeline_11, name="GROUND::TRAVERTINE_GND")  # -> report, faces; plug-in component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
split = SplitList(List=jitter.Values, Index="50")  # -> ListA, ListB
face_5 = HBFace(geo=dpipeline_4, name="WATER::BODY_GND")  # -> report, faces; plug-in component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
face_6 = HBFace(geo=dpipeline_7, name="CONTEXT::FENCE")  # -> report, faces; plug-in component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
face_7 = HBFace(geo=dpipeline_9, name="CONTEXT::FABRIC")  # -> report, faces; plug-in component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
face_8 = HBFace(geo=dpipeline_8, name="CONTEXT::BUILDING")  # -> report, faces; plug-in component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
reduce = RandomReduce(List=series_2, Reduction="5", Seed=1)
item = ListItem(List=demesh.Faces, Index=split.ListA, Wrap=True)
conmesh = ConstructMesh(Vertices=demesh.Vertices, Faces=item)
difference = SetDifference(SetA=series_2, SetB=reduce)
face_9 = HBFace(geo=conmesh, name="VEGETATION::TREE")  # -> report, faces; plug-in component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
item_2 = ListItem(List=dpipeline_2, Index=difference, Wrap=True)
item_3 = ListItem(List=dpipeline_2, Index=reduce, Wrap=True)
bbox = BoundingBox(Content=item_3, Plane=PlaneXY(0, 0, 0), UnionBox=True)  # -> Box, Box_2
bbox_2 = BoundingBox(Content=item_2, Plane=PlaneXY(0, 0, 0), UnionBox=True)  # -> Box, Box_2
debrep = DeconstructBrep(Brep=bbox.Box)  # -> Faces, Edges, Vertices
debrep_2 = DeconstructBrep(Brep=bbox_2.Box)  # -> Faces, Edges, Vertices
toggle = BooleanToggle(False)
item_4 = ListItem(List=debrep.Faces, Index="5", Wrap=True)
item_5 = ListItem(List=debrep_2.Faces, Index="5", Wrap=True)
entwine = Entwine(
    Branch00=face_8.faces,
    Branch01=face_7.faces,
    Branch02=face_6.faces,
    Branch03=face_5.faces,
    Branch04=face_4.faces,
    Branch05=face_3.faces,
    Branch06=face_2.faces,
    Branch07=face_9.faces,
    Branch08=face.faces,
    FlattenInputs=True)
genpts = LBGeneratePointGrid(geometry=item_4, grid_size="2", offset_dist="5", quad_only=toggle)  # -> points, vectors, face_areas, graft(mesh); plug-in component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
genpts_2 = LBGeneratePointGrid(geometry=item_5, grid_size="2", offset_dist="5", quad_only=toggle)  # -> points, vectors, face_areas, graft(mesh); plug-in component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
mjoin = MeshJoin(Meshes=item_3)
mjoin_2 = MeshJoin(Meshes=item_2)
Z = UnitZ(Factor="-1")
Z_2 = UnitZ(Factor="-1")
meshray = MeshRay(Mesh=mjoin, Point=genpts.points, Direction=Z)  # -> Point, Hit
meshray_2 = MeshRay(Mesh=mjoin_2, Point=genpts_2.points, Direction=Z_2)  # -> Point, Hit
Z_3 = UnitZ(Factor="1.2")
Z_4 = UnitZ(Factor="1.2")
move = Move(Geometry=meshray.Point, Motion=Z_3)  # -> Geometry, Transform
move_2 = Move(Geometry=meshray_2.Point, Motion=Z_4)  # -> Geometry, Transform
clean = CleanTree(RemoveNulls=True, RemoveInvalid=True, RemoveEmpty=False, Tree=move.Geometry)
clean_2 = CleanTree(RemoveNulls=True, RemoveInvalid=True, RemoveEmpty=False, Tree=move_2.Geometry)
sensor_points = Point(clean_2)
sensor_points_2 = Point(clean)
pt = Point([sensor_points_2, sensor_points])
entwine_2 = Entwine(Branch00=sensor_points, Branch01=sensor_points_2, FlattenInputs=True)  # -> simplify(Result)
panel_2 = Panel("""GRID_A
GRID_B""")
sensorgrid = HBSensorGrid(name=graft(panel_2), positions=entwine_2)  # -> flatten(grid); plug-in component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
panel_3 = Panel("LadybugToolsToolkit_SpatialComfort")
model = HBModel(faces=flatten(entwine), name=panel_3)  # -> report, model; plug-in component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
panel_4 = Panel("C:\ProgramData\BHoM\Extensions\PythonCode\LadybugTools_Toolkit\test\GBR_London.Gatwick.037760_IWEC.epw")
recipesettings = HBRecipeSettings(reload_old=False)  # -> settings; plug-in component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
assigngridsviews = HBAssignGridsAndViews(model=model.model, grids=flatten(sensorgrid))  # -> model; plug-in component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
falsestart = LBFalseStartToggle(False)
wea = HBWeaFromEPW(epw_file=panel_4)  # -> wea; plug-in component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
python = GhPythonScript(bodies=dpipeline_4)  # -> out, body_pts; inputs bodies: list of Surface
# ---------- python: Python ----------
import Rhino
import rhinoscriptsyntax as rs
import ghpythonlib.treehelpers as th

body_pts = []
for body in _bodies_:
    if not rs.IsSurface(body):
        raise ValueError("A body passed to _bodies_ is not a Srf object!")
       
    # convert surface to brep
    brep = Rhino.Geometry.Surface.ToBrep(body)
#    brep = Rhino.Geometry.Brep.CreateFromSurface(body)
    
    # Get curves bounding the surface
#    msh = Rhino.Geometry.Mesh.CreateFromBrep(brep)
#    crvs = rs.MeshOutline(msh[0])
#    crvs = Rhino.Geometry.Brep.DuplicateEdgeCurves(brep)
#    Rhino.Geometry.BrepEdgeList(brep)
    
#    # Join curves into single curve
#    crv = rs.JoinCurves(crvs)
#    
#    # Segmentize crv
#    pts = rs.DivideCurveEquidistant(crv, 1, False)
#    body_pts.append(pts)
#    pt_coords = [[pt.X, pt.Y, pt.Z] for pt in pts]
#    pt_coords.append([pts[0].X, pts[0].Y, pts[0].Z])
#    body_pts.append(pt_coords)

#body_pts = th.list_to_tree(body_pts, source=[0,0])
body_pts = brep
# ---------- end python ----------
annualirradiance = HBAnnualIrradiance(model=assigngridsviews, wea=wea, run_settings=recipesettings, run=falsestart)  # -> report, results, res_direct, avg_irr, peak_irr, radiation; plug-in component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
skyview = HBSkyView(model=assigngridsviews, run_settings=recipesettings, run=falsestart)  # -> report, results; plug-in component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
watersources = GhPythonScript(points=dpipeline_3, bodies=dpipeline_4, name=panel_3)  # inputs points: list of Point3d, bodies: list of Surface
# ---------- watersources: Python ----------
"""
Generate a JSON file containing locations of water sources (Points for misting and Breps for bodies.
_
The resultant file will be stored in the target folder specified by the run_settings_ object.
_

-
    Args:
        _points_: A list of points representing sources of misting.
        _bodies: A list of water bodies.
        _name: Settings from the "HB Recipe Settings" component that specify
            where the resultant file will be generated.
"""

import os
import json
import Rhino
from honeybee.config import folders as hb_folders
import rhinoscriptsyntax as rs

sim_dir = os.path.join(hb_folders.default_simulation_folder, _name)
if not os.path.exists(sim_dir):
    os.mkdir(sim_dir)

d = {
    "points": [],
    "bodies": [],
}

for pt in _points_:
    d["points"].append([pt.X, pt.Y, pt.Z])

for body in _bodies_:
    if not rs.IsSurface(body):
        raise ValueError("A body passed to _bodies_ is not a Srf object!")
       
    # convert surface to brep
    brep = Rhino.Geometry.Brep.CreateFromSurface(body)
    
    # Get curves bounding the surface
    crvs = rs.DuplicateEdgeCurves(brep, False)
    
    # Join curves into single curve
    crv = rs.JoinCurves(crvs)
    
    # Segmentize crv
    pts = rs.DivideCurveEquidistant(crv, 1, False)
    pt_coords = [[pt.X, pt.Y, pt.Z] for pt in pts]
    pt_coords.append([pts[0].X, pts[0].Y, pts[0].Z])
    d["bodies"].append(pt_coords)

with open(os.path.join(sim_dir, "water_sources.json"), "w") as fp:
    json.dump(d, fp)
# ---------- end watersources ----------
