# Grasshopper definition external_comfort.gh (Grasshopper 1.0.7)
# plug-ins: LadybugGrasshopper

gnd = Surface([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])
wall = Surface([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])
shd = Surface(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)
panel = Panel("""GROUND_A
GROUND_B""")
panel_2 = Panel("""0.34
0.2""")
opaquemod = HBOpaqueModifier(name=panel, reflect=panel_2)  # -> modifier; plug-in component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
opaquemod_2 = HBOpaqueModifier(name="WALL", reflect="0.5")  # -> modifier; plug-in component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
glassmod = HBGlassModifier(name="SHADE", trans="0.4")  # -> modifier; plug-in component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
genpts = LBGeneratePointGrid(geometry=gnd, grid_size="0.5", offset_dist="1.2", quad_only=Toggle(False))  # -> points, vectors, face_areas, graft(mesh); plug-in component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
shade = HBShade(geo=shd, name="SHADE", rad_mod=glassmod)  # -> report, shades; plug-in component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
face = HBFace(geo=gnd, name=panel, type="Floor", rad_mod=opaquemod)  # -> report, faces; plug-in component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
face_2 = HBFace(geo=wall, name="WALL", type="Floor", rad_mod=opaquemod_2)  # -> report, faces; plug-in component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
sensorgrid = HBSensorGrid(name=graft(panel), positions=genpts.points, directions=genpts.vectors, mesh=genpts.mesh, base_geo=graft(gnd))  # -> grid; plug-in component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
model = HBModel(
    faces=flatten([face.faces, face_2.faces]),
    shades=flatten(shade.shades),
    name="LadybugTools_ToolkitExternalThermalComfort")  # -> report, model; plug-in component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
panel_3 = Panel("C:\ProgramData\BHoM\Extensions\PythonCode\LadybugTools_Toolkit\test\GBR_London.Gatwick.037760_IWEC.epw")
assigngridsviews = HBAssignGridsAndViews(model=model.model, grids=flatten(sensorgrid))  # -> model; plug-in component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
falsestart = LBFalseStartToggle(False)
wea = HBWeaFromEPW(epw_file=panel_3)  # -> wea; plug-in component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
annualirradiance = HBAnnualIrradiance(model=assigngridsviews, wea=wea, run=falsestart)  # -> report, results, avg_irr, peak_irr, radiation; plug-in component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
skyview = HBSkyView(model=assigngridsviews, run=falsestart)  # -> report, results; plug-in component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
